# Grasshopper definition ALFA_Visualization_Script.gh (Grasshopper 1.0.7)
# plug-ins: Human, EleFront, TT Toolbox

list = ValueList({"Vertical": 0, "Horizontal": 1, "OFF": 2}, selected="OFF")
list_2 = ValueList({"Sensors": 0, "Workplanes": 1, "OFF": 2}, selected="Sensors")
# Capture Parameters
office_model = Panel("HypOffice_Skylight_10ft_")
list_3 = ValueList({"Unidirectional Sensors": 0, "Multidirectional Sensors": 1, "EML Workplanes": 2, "Lux Workplanes": 3}, selected="Multidirectional Sensors")
timer = Timer(TimerInterval=1000, Target=currentviewcapture)  # disabled

# ----
# Parameters
list_4 = ValueList({"June 21 9am - Clear": 0, "June 21 11am - Clear": 3, "June 21 1pm - Clear": 6, "Sept 21 9am - Hazy": 9, "Sept 21 11am - Hazy": 12, "Sept 21 1pm - Hazy": 15, "Dec 21 9am - Overcast": 18, "Dec 21 11am - Overcast": 21, "Dec 21 1pm - Overcast": 24}, selected="Sept 21 11am - Hazy")
list_5 = ValueList({"North": 4, "East": 2, "South": 8, "West": 6, "All": "2,3,4,5,6,7,8,9"}, selected="All")
list_6 = ValueList({"Unidirectional": 0, "Multidirectional": 1, "Workplane": 2}, selected="Multidirectional")
sensor_scale = Slider(0.49, range=0..10)
tag_offset = Slider(0.72, range=0..4)
tag_size = Slider(0.13, range=0..1)
tag_color = Slider(0.9, range=0..1)
eml_min = Slider(240, range=0..3000)
eml_max = Slider(960, range=0..3000)
lux_min = Slider(300, range=0..3000)
lux_max = Slider(3000, range=0..3000)
m_p_min = Slider(0, range=0..2)
m_p_max = Slider(1, range=0..2)
sensors = ValueList({"EML": 7, "LUX": 8, "M/P": 9}, selected="EML")

overlit_contour = ValueList({"One": 1, "Three": 3}, selected="Three")
hatch_direction = ValueList({"0", "1"}, selected="1")
# Contour Parameters
underlit_contour = ValueList({"One": 1, "Three": 3}, selected="One")
sensors_deep = Slider(35, range=0..40)

# ---- group: Workplanes
# Parameters
sensor_scale_2 = Slider(0.5, range=0..10)
tag_size_2 = Slider(0.16, range=0..1)
tag_color_2 = Slider(0, range=0..1)
eml_min_2 = Slider(240, range=0..3000)
eml_max_2 = Slider(960, range=0..3000)
lux_min_2 = Slider(300, range=0..3000)
lux_max_2 = Slider(3000, range=0..3000)
m_p_min_2 = Slider(0, range=0..2)
m_p_max_2 = Slider(1, range=0..2)
tag_offset_2 = Slider(0.65, range=0..4)

# Parameters
list_7 = ValueList({"EML": 7, "LUX": 8, "M/P": 9}, selected="LUX")
eml_min_3 = Slider(240, range=0..3000)
eml_max_3 = Slider(960, range=0..3000)
lux_min_3 = Slider(300, range=0..3000)
lux_max_3 = Slider(3000, range=0..3000)
m_p_min_3 = Slider(0, range=0..2)
m_p_max_3 = Slider(1, range=0..2)

# Contour Parameters
list_8 = ValueList({"Smooth": 0, "Absolute": 1}, selected="Smooth")
smoothness = Slider(10, range=1..15)
sensors_deep_2 = Slider(35, range=0..40)
contour_max_value = Slider(3000, range=0..3000)
contour_min_value = Slider(300, range=0..3000)
dim_hatch_color = Slider(1, range=0..1)
bright_hatch_color = Slider(0, range=0..1)

# ----
number_slider = Slider(5, range=0..10)
crv = Curve(<curve referenced from the Rhino model>)
workplanes = ValueList({"EML": 7, "LUX": 8, "M/P": 9}, selected="LUX")
num = Number([0, 3, 6, 9, 12, 15, 9, 12, 15, 21, 24])
brep = Brep(<brep referenced from the Rhino model>)

# ----
# Select Files
workplanes_file = FilePath("D:\Google Drive\Course Files\Spring 2019\Thesis\Circadian Simulations\Hypothetical Office\ALFA Data\HypOffice_70ft_Punched_8ft_40wwr\HypOffice_70ft_Punched_8ft_.40wwr_South_Workplanes.xls")
sensors_file = FilePath("D:\Google Drive\Course Files\Spring 2019\Thesis\Circadian Simulations\Hypothetical Office\ALFA Data\HypOffice_70ft_Punched_8ft_40wwr\HypOffice_70ft_Punched_8ft_.40wwr_South.xls")

# ---- group: Capture Script
txt = Text(["0", "1", "2", "3", "4", "5", "6", "7", "8"])
txt_2 = Text(["0", "0", "East", "0", "North", "0", "West", "0", "South"])
rep = ReplaceText(Text=list_5, Find=txt, Replace=txt_2, RecursiveReplace=False)
item = ListItem(List=rep, Index=list_5, Wrap=True)
file_path = Text("D:\Processing")
png = Text("png")

# ---- group: Excel Data Output
target_eml_1 = Slider(960, range=0..1000)
target_eml_2 = Slider(240, range=0..500)
division = Division(A=list_4, B=3)
path = ConstructPath(Indices=division)
path_2 = FilePath("D:\Google Drive\Course Files\Spring 2019\Thesis\Circadian Simulations\Hypothetical Office\Results\Wdw_Head_Height.xlsx")
wo = WriteOptions(
    FilePath=path_2,
    ClearDataOverwrite=True,
    SaveAfterWrite=False,
    CloseAfterWrite=False,
    ColumnStartPosition=2,
    RowStartPosition=1)  # -> UserMessages, WriteOptions
write = BooleanToggle(False)
txt_3 = Text(["South", "Southeast", "East", "Northeast", "North", "Northwest", "West", "Southwest"])

# ---- group: Data Retrieval
run = BooleanToggle(True)
split = TextSplit(Text=sensors_file, Separators="\")
lng = ListLength(List=split)
item_2 = ListItem(List=split, Index=expr("X-1", lng), Wrap=True)
split_2 = TextSplit(Text=list_5, Separators=",")
addition = Addition(A=sensors, B=list_4)

# ----
readxl = ReadExcelSheet(Run=run, FilePath=sensors_file, Worksheet="1", Listen=False)  # -> UserMessages, Columns, Rows

# ---- group: Capture Script (continued)
item_3 = TreeItem(Tree=readxl.Columns, Path=addition, Index=0, Wrap=True)
split_3 = TextSplit(Text=item_3, Separators="_")
item_4 = ListItem(List=split_3, Index=0, Wrap=True)  # -> Item, Item1
concat = Concatenate(FragmentA=item_4.Item, FragmentB="_", FragmentC=item_4.Item1)
planes_img_title = Concatenate(
    FragmentI=office_model,
    FragmentA=concat,
    FragmentC="_",
    FragmentB=item,
    FragmentF="_",
    FragmentD=eml_min,
    FragmentG="-",
    FragmentE=eml_max,
    FragmentH="EML_Sensors")
sensors_img_title = Concatenate(
    FragmentI=office_model,
    FragmentA=concat,
    FragmentC="_",
    FragmentD=eml_min,
    FragmentG="-",
    FragmentE=eml_max,
    FragmentH="EML_Sensors")
workplanes_img_title = Concatenate(
    FragmentI=office_model,
    FragmentA=concat,
    FragmentC="_",
    FragmentD=lux_min,
    FragmentG="-",
    FragmentE=lux_max,
    FragmentH="lx_Workplanes")
workplanes_eml_img_title = Concatenate(
    FragmentI=office_model,
    FragmentA=concat,
    FragmentC="_",
    FragmentD=eml_min,
    FragmentG="-",
    FragmentE=eml_max,
    FragmentH="EML_Workplanes")
filter = StreamFilter(
    Gate=list_3,
    Stream0=planes_img_title,
    Stream1=sensors_img_title,
    Stream2=workplanes_eml_img_title,
    Stream3=workplanes_img_title)
panel = Panel(filter)
currentviewcapture = CurrentViewCapture(
    PathToFile=file_path,
    FileName=filter,
    Extension=png,
    Width=Slider(3000, range=0..4000),
    Height=Slider(4000, range=0..4000),
    DrawGrid=Toggle(False),
    DrawWorldAxes=Toggle(False),
    DrawCPlaneAxes=Toggle(False),
    Activate=Toggle(False))  # -> out, A
# ---------- currentviewcapture: VB ----------
    ' Script created by Eduard Haiman haiman-ed@yandex.ru
    ' Write to PathToFile like C:\Users , without final "\"
    ' Extension can be bmp, tga, jpg, pcx, png or tif
    ' Don't forget to set Activate to  "False"  before close the GH file

    If PathToFile = ""

      print("Path " & PathToFile & " does not exist!")
      Return

    Else
      If Dir(PathToFile & "\") <> "" Then
      Else
        print("Path """ & PathToFile & "\" & """ does not exist!")
        Return
      End If
    End If

    Dim DrawGridVB As String = "No"
    Dim DrawWorldAxesVB As String = "No"
    Dim DrawCPlaneAxesVB As String = "No"
    Dim FullName As String = PathToFile & "\" & FileName & "." & Extension


    If DrawGrid Then
      DrawGridVB = "Yes"
    Else
      DrawGridVB = "No"
    End If

    If DrawWorldAxes Then
      DrawWorldAxesVB = "Yes"
    Else
      DrawWorldAxesVB = "No"
    End If

    If DrawCPlaneAxes Then
      DrawCPlaneAxesVB = "Yes"
    Else
      DrawCPlaneAxesVB = "No"
    End If

    print("FullName " & FullName)
    print("Width=" & Width & " Height=" & Height)
    print("DrawGrid=" & DrawGridVB & " DrawWorldAxes=" & DrawWorldAxesVB & " DrawCPlaneAxes=" & DrawCPlaneAxesVB)

    If Activate Then
      app.RunScript("-viewcapturetofile """ & FullName & """ Width=" & Width & " Height=" & Height & " DrawGrid=" & DrawGridVB & " DrawWorldAxes=" & DrawWorldAxesVB & " DrawCPlaneAxes=" & DrawCPlaneAxesVB & " _Enter")
      print("Active...")

      If Dir(FullName) <> "" Then
        print(FileName & "." & Extension & " was CREATED!")
      Else
        print(FileName & "." & Extension & " was NOT created!")
      End If


    Else print("Inactive...")
    End If
# ---------- end currentviewcapture ----------
panel_2 = Panel(currentviewcapture.out)

# ---- group: Data Retrieval (continued)
lng_2 = ListLength(List=readxl.Columns)
branch = TreeBranch(Tree=lng_2, Path="{1}", MaintainPaths=True)
series = Series(Start=split_2, Step=8, Count=expr("(X-2)/8", branch))

# ---- group: Sensor Positions
series_2 = Series(Start=1, Step=1, Count=6)
item_5 = TreeItem(Tree=readxl.Columns, Path=graft(series_2), Index=flatten(series), Wrap=True)
bang = ExplodeTree(Data=item_5)  # -> Branch0, Branch1, Branch2, Branch3, Branch4, Branch5
pt = ConstructPoint(XCoordinate=bang.Branch0, YCoordinate=bang.Branch1, ZCoordinate=bang.Branch2)
vec = VectorXYZ(XComponent=bang.Branch3, YComponent=bang.Branch4, ZComponent=bang.Branch5)  # -> Vector, Length

# ---- group: Sensor Data
item_6 = TreeItem(Tree=readxl.Columns, Path=addition, Index=flatten(series), Wrap=True)
item_7 = TreeItem(Tree=readxl.Columns, Path=addition, Index=1, Wrap=True)
txt_4 = Text(["EML", "Lux", "M/P"])
num_2 = Number([0, 1, 2])
rep_2 = ReplaceText(Text=item_7, Find=txt_4, Replace=num_2, RecursiveReplace=False)
tsort = SortText(Keys=rep_2, Culture=127)  # -> Keys, Values
item_8 = ListItem(List=tsort.Keys, Index=0, Wrap=True)
gate = StreamGate(Stream=item_6, Gate=item_8)  # -> Target0, Target1, Target2

# ---- group: Excel Data Output (continued)
avg_dist_from_wdw = AvgDistFromWdw(C=branch, L=pt, L_2=item_6, subset_length=sensors_deep, B=target_eml_1, curve=crv)  # -> R, N
avg_dist_from_wdw_2 = AvgDistFromWdw(C=branch, L=pt, L_2=item_6, subset_length=sensors_deep, B=target_eml_2, curve=crv)  # -> R, N
panel_3 = Panel(avg_dist_from_wdw_2.R)
panel_4 = Panel(avg_dist_from_wdw.R)
replace = ReplacePaths(Data=item_3, Search="{0}", Replace=path)
replace_2 = ReplacePaths(Data=avg_dist_from_wdw.N, Search="{0}", Replace=path)
rec = DataRecorder(replace_2, DataLimit=-10, RecordData=False)
rec_2 = DataRecorder(replace, DataLimit=-10, RecordData=False)
panel_5 = Panel(rec)
panel_6 = Panel(rec_2)
writexl = WriteToExcel(
    Run=write,
    ExcelWorksheet="1",
    ColumnNames=txt_3,
    RowNames=rec_2,
    WriteOptions=wo.WriteOptions,
    ColumnnsOrRows=True,
    DataToWriteIntoColumns=rec)

# ----
panel_7 = Panel(item_7)

# ---- group: TAG
multiplication = Multiplication(A=gate.Target2, _1000=1000)
int = Integer(multiplication)
division_2 = Division(A=int, _10=10)
gate_2 = StreamGate(Stream=pt, Gate=list_6)  # -> Target0, Target1, Target2
multiplication_2 = Multiplication(A=vec.Vector, B=tag_offset)
int_2 = Integer([gate.Target1, gate.Target0])
move = Move(Geometry=[gate_2.Target0, gate_2.Target1], Motion=multiplication_2)  # -> Geometry, Transform
cmyk = ColourCMYK(Cyan=0, Magenta=0, Yellow=0, Key=tag_color)
tag = TextTag3D(Location=graft([move.Geometry, gate_2.Target2]), Text=graft(int_2), Size=tag_size, Colour=cmyk, Justification=5)

# ----
panel_8 = Panel(item_2)

# ---- group: Workplanes / Data Retrieval
run_2 = BooleanToggle(True)
split_4 = TextSplit(Text=workplanes_file, Separators="\")
lng_3 = ListLength(List=split_4)
item_9 = ListItem(List=split_4, Index=expr("X-1", lng_3), Wrap=True)
addition_2 = Addition(A=workplanes, B=list_4)

# ----
panel_9 = Panel(item_9)

# ---- group: Workplanes / Data Retrieval
run_3 = BooleanToggle(True)
split_5 = TextSplit(Text=workplanes_file, Separators="\")
lng_4 = ListLength(List=split_5)
item_10 = ListItem(List=split_5, Index=expr("X-1", lng_4), Wrap=True)
addition_3 = Addition(A=list_7, B=list_4)

# ---- group: Workplanes
readxl_2 = ReadExcelSheet(Run=run_2, FilePath=workplanes_file, Worksheet="1", Listen=False)  # -> UserMessages, Columns, Rows

# ---- group: Workplanes / Data Retrieval (continued)
lng_5 = ListLength(List=readxl_2.Columns)
branch_2 = TreeBranch(Tree=lng_5, Path="{1}", MaintainPaths=True)
series_3 = Series(Start=2, Step=1, Count=expr("X-2", branch_2))

# ---- group: Workplanes / Sensor Positions
series_4 = Series(Start=1, Step=1, Count=6)
item_11 = TreeItem(Tree=readxl_2.Columns, Path=graft(series_4), Index=series_3, Wrap=True)
bang_2 = ExplodeTree(Data=item_11)  # -> Branch0, Branch1, Branch2, Branch3, Branch4, Branch5
pt_2 = ConstructPoint(XCoordinate=bang_2.Branch0, YCoordinate=bang_2.Branch1, ZCoordinate=bang_2.Branch2)
vec_2 = VectorXYZ(XComponent=bang_2.Branch3, YComponent=bang_2.Branch4, ZComponent=bang_2.Branch5)  # -> Vector, Length

# ---- group: Workplanes / Sensor Data
item_12 = TreeItem(Tree=readxl_2.Columns, Path=addition_2, Index=1, Wrap=True)
item_13 = TreeItem(Tree=readxl_2.Columns, Path=addition_2, Index=series_3, Wrap=True)
num_3 = Number([0, 1, 2])
txt_5 = Text(["EML", "Lux", "M/P"])
rep_3 = ReplaceText(Text=item_12, Find=txt_5, Replace=num_3, RecursiveReplace=False)
tsort_2 = SortText(Keys=rep_3, Culture=127)  # -> Keys, Values
item_14 = ListItem(List=tsort_2.Keys, Index=0, Wrap=True)
gate_3 = StreamGate(Stream=item_13, Gate=item_14)  # -> Target0, Target1, Target2

# ---- group: Workplanes (continued)
panel_10 = Panel(item_12)

# ---- group: Workplanes / TAG
multiplication_3 = Multiplication(A=gate_3.Target2, _1000=1000)
int_3 = Integer(multiplication_3)
division_3 = Division(A=int_3, _10=10)
multiplication_4 = Multiplication(A=vec_2.Vector, B=tag_offset_2)
int_4 = Integer([gate_3.Target1, gate_3.Target0])
move_2 = Move(Geometry=pt_2, Motion=multiplication_4)  # -> Geometry, Transform
cmyk_2 = ColourCMYK(Cyan=0, Magenta=0, Yellow=0, Key=tag_color_2)
tag_2 = TextTag3D(Location=graft(move_2.Geometry), Text=graft([division_3, int_4]), Size=tag_size_2, Colour=cmyk_2, Justification=5)

# ---- group: Workplanes
readxl_3 = ReadExcelSheet(Run=run_3, FilePath=workplanes_file, Worksheet="1", Listen=False)  # -> UserMessages, Columns, Rows

# ---- group: Workplanes / Data Retrieval (continued)
lng_6 = ListLength(List=readxl_3.Columns)
branch_3 = TreeBranch(Tree=lng_6, Path="{1}", MaintainPaths=True)
series_5 = Series(Start=2, Step=1, Count=expr("X-2", branch_3))

# ---- group: Workplanes / Sensor Data
item_15 = TreeItem(Tree=readxl_3.Columns, Path=addition_3, Index=1, Wrap=True)
item_16 = TreeItem(Tree=readxl_3.Columns, Path=addition_3, Index=series_5, Wrap=True)
num_4 = Number([0, 1, 2])
txt_6 = Text(["EML", "Lux", "M/P"])
rep_4 = ReplaceText(Text=item_15, Find=txt_6, Replace=num_4, RecursiveReplace=False)
tsort_3 = SortText(Keys=rep_4, Culture=127)  # -> Keys, Values
item_17 = ListItem(List=tsort_3.Keys, Index=0, Wrap=True)
gate_4 = StreamGate(Stream=item_16, Gate=item_17)  # -> Target0, Target1, Target2

# ---- group: Workplanes / Sensor Positions
series_6 = Series(Start=1, Step=1, Count=6)
item_18 = TreeItem(Tree=readxl_3.Columns, Path=graft(series_6), Index=series_5, Wrap=True)
bang_3 = ExplodeTree(Data=item_18)  # -> Branch0, Branch1, Branch2, Branch3, Branch4, Branch5
pt_3 = ConstructPoint(XCoordinate=bang_3.Branch0, YCoordinate=bang_3.Branch1, ZCoordinate=bang_3.Branch2)
vec_3 = VectorXYZ(XComponent=bang_3.Branch3, YComponent=bang_3.Branch4, ZComponent=bang_3.Branch5)  # -> Vector, Length

# ---- group: Workplanes
series_7 = Series(Start=0, Step=1, Count=20)
series_8 = Series(Start=series_7, Step=20, Count=sensors_deep_2)
item_19 = ListItem(List=item_16, Index=series_8, Wrap=True)
series_9 = Series(Start=0, Step=1, Count=20)
smaller = SmallerThan(FirstNumber=item_19, SecondNumber=contour_min_value)  # -> SmallerThan, OrEqualTo
series_10 = Series(Start=series_9, Step=20, Count=sensors_deep_2)
bool = Boolean([True, False])
mindex = MemberIndex(Set=smaller.SmallerThan, Member=bool)  # -> Index, Count
item_20 = ListItem(List=pt_3, Index=series_10, Wrap=True)
item_21 = ListItem(List=mindex.Count, Index=hatch_direction, Wrap=False)
replace_3 = ReplaceMembers(Set=item_21, Find=35, Replace=34)
item_22 = ListItem(List=item_20, Index=replace_3, Wrap=False)  # -> flatten(Item)
gate_5 = StreamGate(Stream=item_22, Gate=list_8)  # -> Target0, Target1
nurbs = NurbsCurve(Vertices=gate_5.Target0, Degree=smoothness, Periodic=False)  # -> Curve, Length, Domain
intcrv = Interpolate(Vertices=gate_5.Target1, Degree=3, Periodic=False, KnotStyle=0)  # -> Curve, Length, Domain

# ---- group: Workplanes / Contour Curve
series_11 = Series(Start=0, Step=1, Count=20)
series_12 = Series(Start=series_11, Step=20, Count=sensors_deep_2)
item_23 = ListItem(List=item_16, Index=series_12, Wrap=True)
smaller_2 = SmallerThan(FirstNumber=item_23, SecondNumber=contour_max_value)  # -> SmallerThan, OrEqualTo
series_13 = Series(Start=0, Step=1, Count=20)
series_14 = Series(Start=series_13, Step=20, Count=sensors_deep_2)
bool_2 = Boolean([True, False])
mindex_2 = MemberIndex(Set=smaller_2.SmallerThan, Member=bool_2)  # -> Index, Count
item_24 = ListItem(List=pt_3, Index=series_14, Wrap=True)
item_25 = ListItem(List=mindex_2.Count, Index=hatch_direction, Wrap=False)
replace_4 = ReplaceMembers(Set=item_25, Find=35, Replace=34)
item_26 = ListItem(List=item_24, Index=replace_4, Wrap=False)  # -> flatten(Item)
gate_6 = StreamGate(Stream=item_26, Gate=list_8)  # -> Target0, Target1
nurbs_2 = NurbsCurve(Vertices=gate_6.Target0, Degree=smoothness, Periodic=False)  # -> Curve, Length, Domain
intcrv_2 = Interpolate(Vertices=gate_6.Target1, Degree=3, Periodic=False, KnotStyle=0)  # -> Curve, Length, Domain

# ---- group: Workplanes / Hatch Blocks
larger = LargerThan(FirstNumber=item_16, SecondNumber=contour_max_value)  # -> LargerThan, OrEqualTo
smaller_3 = SmallerThan(FirstNumber=item_16, SecondNumber=contour_min_value)  # -> SmallerThan, OrEqualTo
bool_3 = Boolean([True, False])
bool_4 = Boolean([True, False])
mindex_3 = MemberIndex(Set=larger.LargerThan, Member=bool_3)  # -> Index, Count
mindex_4 = MemberIndex(Set=smaller_3.SmallerThan, Member=bool_4)  # -> Index, Count
branch_4 = TreeBranch(Tree=mindex_3.Index, Path="{1;0;0}", MaintainPaths=True)
branch_5 = TreeBranch(Tree=mindex_4.Index, Path="{1;0;0}", MaintainPaths=True)
item_27 = ListItem(List=pt_3, Index=branch_4, Wrap=False)
item_28 = ListItem(List=pt_3, Index=branch_5, Wrap=False)
brep_2 = Brep(<brep referenced from the Rhino model>)
brep_3 = Brep(<brep referenced from the Rhino model>)
move_3 = Move(Geometry=brep_2, Motion=item_27)  # -> Geometry, Transform
move_4 = Move(Geometry=brep_3, Motion=item_28)  # -> Geometry, Transform
scale = Scale(Geometry=move_3.Geometry, Center=item_27, Factor=0.5)  # -> Geometry, Transform
scale_2 = Scale(Geometry=move_4.Geometry, Center=item_28, Factor=0.5)  # -> Geometry, Transform
hatch = DefineHatch(Curve=scale.Geometry, Pattern="Plus", Rotation=45, Scale=1.6)
hatch_2 = DefineHatch(Curve=scale_2.Geometry, Pattern="Hatch_Horizontal", Rotation=45, Scale=8)
cmyk_3 = ColourCMYK(Cyan=0, Magenta=1, Yellow=1, Key=bright_hatch_color)
cmyk_4 = ColourCMYK(Cyan=0, Magenta=0, Yellow=0, Key=dim_hatch_color)
preview = CustomPreview(Geometry=hatch, Material=flatten(cmyk_3))
preview_2 = CustomPreview(Geometry=hatch_2, Material=flatten(cmyk_4))

# ---- group: Workplanes
ssln = SubsetListsWithLengthN(list=pt_3, subset_length=sensors_deep_2, cull_remainder=False)  # -> L, I
ssln_2 = SubsetListsWithLengthN(list=item_16, subset_length=sensors_deep_2, cull_remainder=False)  # -> L, I
smaller_4 = SmallerThan(FirstNumber=ssln_2.L, SecondNumber=contour_min_value)  # -> SmallerThan, OrEqualTo
bool_5 = Boolean([True, False])
mindex_5 = MemberIndex(Set=smaller_4.SmallerThan, Member=bool_5)  # -> Index, Count
item_29 = ListItem(List=mindex_5.Count, Index=hatch_direction, Wrap=False)
replace_5 = ReplaceMembers(Set=item_29, Find=35, Replace=34)
item_30 = ListItem(List=ssln.L, Index=replace_5, Wrap=False)  # -> flatten(Item)
gate_7 = StreamGate(Stream=item_30, Gate=list_8)  # -> Target0, Target1
nurbs_3 = NurbsCurve(Vertices=gate_7.Target0, Degree=smoothness, Periodic=False)  # -> Curve, Length, Domain
intcrv_3 = Interpolate(Vertices=gate_7.Target1, Degree=3, Periodic=False, KnotStyle=0)  # -> Curve, Length, Domain

panel_11 = Panel(item_15)

# ---- group: Sensor
brep_4 = Brep(<brep referenced from the Rhino model>)
brep_5 = Brep(<brep referenced from the Rhino model>)
filter_2 = StreamFilter(Gate=list_6, Stream0=brep_4, Stream1=brep_5, Stream2=brep)
move_5 = Move(Geometry=filter_2, Motion=pt)  # -> Geometry, Transform
gradient = Gradient(
    LowerLimit=eml_min,
    UpperLimit=eml_max,
    Parameter=gate.Target0,
    stops=[0: RGB(166, 166, 166), 0.203: RGB(135, 206, 235), 0.397: RGB(0, 191, 255), 0.598: RGB(30, 144, 255), 0.796: RGB(65, 105, 225), 1: RGB(0, 0, 255)])
gradient_2 = Gradient(
    LowerLimit=lux_min,
    UpperLimit=lux_max,
    Parameter=gate.Target1,
    stops=[0: RGB(0, 0, 255), 0.329: RGB(0, 255, 0), 0.663: RGB(255, 128, 0), 1: RGB(255, 0, 0)])
gradient_3 = Gradient(
    LowerLimit=m_p_min,
    UpperLimit=m_p_max,
    Parameter=gate.Target2,
    stops=[0: RGB(255, 0, 0), 0.247: RGB(255, 165, 60), 0.503: RGB(255, 255, 128), 0.747: RGB(135, 206, 235), 1: RGB(30, 144, 255)])
scale_3 = Scale(Geometry=move_5.Geometry, Center=pt, Factor=sensor_scale)  # -> Geometry, Transform
Y = UnitY(Factor=-1)

# ----
gate_8 = StreamGate(Stream=scale_3.Geometry, Gate=list_6)  # -> Target0, Target1, Target2

# ---- group: Workplanes / Contour Curve
ssln_3 = SubsetListsWithLengthN(list=pt_3, subset_length=sensors_deep_2, cull_remainder=False)  # -> L, I
ssln_4 = SubsetListsWithLengthN(list=item_16, subset_length=sensors_deep_2, cull_remainder=False)  # -> L, I
smaller_5 = SmallerThan(FirstNumber=ssln_4.L, SecondNumber=contour_max_value)  # -> SmallerThan, OrEqualTo
bool_6 = Boolean([True, False])
mindex_6 = MemberIndex(Set=smaller_5.SmallerThan, Member=bool_6)  # -> Index, Count
item_31 = ListItem(List=mindex_6.Count, Index=hatch_direction, Wrap=False)
replace_6 = ReplaceMembers(Set=item_31, Find=35, Replace=34)
item_32 = ListItem(List=ssln_3.L, Index=replace_6, Wrap=False)  # -> flatten(Item)

# ---- group: Workplanes (continued)
gate_9 = StreamGate(Stream=item_32, Gate=list_8)  # -> Target0, Target1

# ---- group: Workplanes / Contour Curve (continued)
nurbs_4 = NurbsCurve(Vertices=gate_9.Target0, Degree=smoothness, Periodic=False)  # -> Curve, Length, Domain
intcrv_4 = Interpolate(Vertices=gate_9.Target1, Degree=3, Periodic=False, KnotStyle=0)  # -> Curve, Length, Domain

# ----
filter_3 = StreamFilter(
    Gate=list,
    Stream0=[nurbs_4.Curve, nurbs_3.Curve, intcrv_4.Curve, intcrv_3.Curve],
    Stream1=[nurbs_2.Curve, nurbs.Curve, intcrv_2.Curve, intcrv.Curve])

# ---- group: Workplanes / Hatch Contours
crv_2 = Curve([<curve referenced from the Rhino model> x2])
edgesrf = EdgeSurface(CurveA=flatten(filter_3), CurveB=flatten(crv_2))
scale_nu = ScaleNU(Geometry=edgesrf, Plane=PlaneXY(0, 0, 0), ScaleX=1.029, ScaleY=1.053, ScaleZ=1)  # -> Geometry, Transform
item_33 = ListItem(List=scale_nu.Geometry, Index=0, Wrap=True)  # -> Item, Item1
hatch_3 = DefineHatch(Curve=item_33.Item1, Pattern="Hatch_Horizontal", Rotation=45, Scale=12)
hatch_4 = DefineHatch(Curve=item_33.Item, Pattern="Plus", Rotation=45, Scale=1.5)
debrep = DeconstructBrep(Brep=scale_nu.Geometry)  # -> Faces, Edges, Vertices
cmyk_5 = ColourCMYK(Cyan=0, Magenta=0, Yellow=0, Key=dim_hatch_color)
item_34 = TreeItem(Tree=debrep.Edges, Path="{0;1}", Index=underlit_contour, Wrap=True)
item_35 = TreeItem(Tree=debrep.Edges, Path="{0;0}", Index=overlit_contour, Wrap=True)
cmyk_6 = ColourCMYK(Cyan=0, Magenta=0, Yellow=0, Key=bright_hatch_color)
preview_3 = CustomPreview(Geometry=hatch_3, Material=cmyk_5)
preview_4 = CustomPreview(Geometry=hatch_4, Material=cmyk_6)
previewlw = CustomPreviewLineweights(Geometry=item_35, Shader=cmyk_6, Thickness=number_slider, Absolute=False)
previewlw_2 = CustomPreviewLineweights(Geometry=item_34, Shader=cmyk_5, Thickness=number_slider, Absolute=False)

# ---- group: Workplanes / Sensor
brep_6 = Brep(<brep referenced from the Rhino model>)
move_6 = Move(Geometry=brep_6, Motion=pt_2)  # -> Geometry, Transform
gradient_4 = Gradient(
    LowerLimit=eml_min_2,
    UpperLimit=eml_max_2,
    Parameter=gate_3.Target0,
    stops=[0: RGB(166, 166, 166), 0.203: RGB(135, 206, 235), 0.397: RGB(0, 191, 255), 0.598: RGB(30, 144, 255), 0.796: RGB(65, 105, 225), 1: RGB(0, 0, 255)])
gradient_5 = Gradient(
    LowerLimit=lux_min_2,
    UpperLimit=lux_max_2,
    Parameter=gate_3.Target1,
    stops=[0: RGB(0, 0, 255), 0.329: RGB(0, 255, 0), 0.663: RGB(255, 128, 0), 1: RGB(255, 0, 0)])
gradient_6 = Gradient(
    LowerLimit=m_p_min_2,
    UpperLimit=m_p_max_2,
    Parameter=gate_3.Target2,
    stops=[0: RGB(255, 0, 0), 0.247: RGB(255, 165, 60), 0.503: RGB(255, 255, 128), 0.747: RGB(135, 206, 235), 1: RGB(30, 144, 255)])
scale_4 = Scale(Geometry=move_6.Geometry, Center=pt_2, Factor=sensor_scale_2)  # -> Geometry, Transform

# ----
filter_4 = StreamFilter(Gate=list_2, Stream1=scale_4.Geometry)

# ---- group: Workplanes / Sensor (continued)
preview_5 = CustomPreview(Geometry=filter_4, Material=[gradient_5, gradient_6, gradient_4])

# ---- group: Sensor (continued)
rotate = RotateDirection(Geometry=[gate_8.Target0, gate_8.Target1], Center=pt, From=Y, To=vec.Vector)  # -> Geometry, Transform

# ----
filter_5 = StreamFilter(Gate=list_2, Stream0=[gate_8.Target2, rotate.Geometry])

# ---- group: Sensor (continued)
preview_6 = CustomPreview(Geometry=filter_5, Material=[gradient, gradient_2, gradient_3])

# ==== cluster AvgDistFromWdw
subset_length = ClusterInput()
C = ClusterInput()
L = ClusterInput()
L_2 = ClusterInput()
B = ClusterInput()
curve = ClusterInput()
num = Number([5, 6, 7, 0, 1, 2, 3, 4])
series = Series(Start=num, Step=8, Count=expr("X/8", C))
bang = ExplodeTree(Data=series)  # -> Branch0, Branch1, Branch2, Branch3, Branch4, Branch5, Branch6, Branch7
crv = Curve(curve)
item = ListItem(List=L, Index=bang.Branch0, Wrap=True)
item_2 = ListItem(List=L_2, Index=bang.Branch0, Wrap=True)
item_3 = ListItem(List=L, Index=bang.Branch1, Wrap=True)
item_4 = ListItem(List=L_2, Index=bang.Branch1, Wrap=True)
item_5 = ListItem(List=L, Index=bang.Branch2, Wrap=True)
item_6 = ListItem(List=L_2, Index=bang.Branch2, Wrap=True)
item_7 = ListItem(List=L, Index=bang.Branch3, Wrap=True)
item_8 = ListItem(List=L_2, Index=bang.Branch3, Wrap=True)
item_9 = ListItem(List=L, Index=bang.Branch4, Wrap=True)
item_10 = ListItem(List=L_2, Index=bang.Branch4, Wrap=True)
item_11 = ListItem(List=L, Index=bang.Branch5, Wrap=True)
item_12 = ListItem(List=L_2, Index=bang.Branch5, Wrap=True)
item_13 = ListItem(List=L, Index=bang.Branch6, Wrap=True)
item_14 = ListItem(List=L_2, Index=bang.Branch6, Wrap=True)
item_15 = ListItem(List=L, Index=bang.Branch7, Wrap=True)
item_16 = ListItem(List=L_2, Index=bang.Branch7, Wrap=True)
ssln = SubsetListsWithLengthN(list=item, subset_length=subset_length, cull_remainder=False)  # -> L, I
ssln_2 = SubsetListsWithLengthN(list=item_2, subset_length=subset_length, cull_remainder=False)  # -> L, I
ssln_3 = SubsetListsWithLengthN(list=item_3, subset_length=subset_length, cull_remainder=False)  # -> L, I
ssln_4 = SubsetListsWithLengthN(list=item_4, subset_length=subset_length, cull_remainder=False)  # -> L, I
ssln_5 = SubsetListsWithLengthN(list=item_5, subset_length=subset_length, cull_remainder=False)  # -> L, I
ssln_6 = SubsetListsWithLengthN(list=item_6, subset_length=subset_length, cull_remainder=False)  # -> L, I
ssln_7 = SubsetListsWithLengthN(list=item_7, subset_length=subset_length, cull_remainder=False)  # -> L, I
ssln_8 = SubsetListsWithLengthN(list=item_8, subset_length=subset_length, cull_remainder=False)  # -> L, I
ssln_9 = SubsetListsWithLengthN(list=item_9, subset_length=subset_length, cull_remainder=False)  # -> L, I
ssln_10 = SubsetListsWithLengthN(list=item_10, subset_length=subset_length, cull_remainder=False)  # -> L, I
ssln_11 = SubsetListsWithLengthN(list=item_11, subset_length=subset_length, cull_remainder=False)  # -> L, I
ssln_12 = SubsetListsWithLengthN(list=item_12, subset_length=subset_length, cull_remainder=False)  # -> L, I
ssln_13 = SubsetListsWithLengthN(list=item_13, subset_length=subset_length, cull_remainder=False)  # -> L, I
ssln_14 = SubsetListsWithLengthN(list=item_14, subset_length=subset_length, cull_remainder=False)  # -> L, I
ssln_15 = SubsetListsWithLengthN(list=item_15, subset_length=subset_length, cull_remainder=False)  # -> L, I
ssln_16 = SubsetListsWithLengthN(list=item_16, subset_length=subset_length, cull_remainder=False)  # -> L, I
smaller = SmallerThan(FirstNumber=ssln_2.L, SecondNumber=B)  # -> SmallerThan, OrEqualTo
smaller_2 = SmallerThan(FirstNumber=ssln_4.L, SecondNumber=B)  # -> SmallerThan, OrEqualTo
smaller_3 = SmallerThan(FirstNumber=ssln_6.L, SecondNumber=B)  # -> SmallerThan, OrEqualTo
smaller_4 = SmallerThan(FirstNumber=ssln_8.L, SecondNumber=B)  # -> SmallerThan, OrEqualTo
smaller_5 = SmallerThan(FirstNumber=ssln_10.L, SecondNumber=B)  # -> SmallerThan, OrEqualTo
smaller_6 = SmallerThan(FirstNumber=ssln_12.L, SecondNumber=B)  # -> SmallerThan, OrEqualTo
smaller_7 = SmallerThan(FirstNumber=ssln_14.L, SecondNumber=B)  # -> SmallerThan, OrEqualTo
smaller_8 = SmallerThan(FirstNumber=ssln_16.L, SecondNumber=B)  # -> SmallerThan, OrEqualTo
bool = Boolean([True, False])
bool_2 = Boolean([True, False])
bool_3 = Boolean([True, False])
bool_4 = Boolean([True, False])
bool_5 = Boolean([True, False])
bool_6 = Boolean([True, False])
bool_7 = Boolean([True, False])
bool_8 = Boolean([True, False])
mindex = MemberIndex(Set=smaller.SmallerThan, Member=bool)  # -> Index, Count
mindex_2 = MemberIndex(Set=smaller_2.SmallerThan, Member=bool_2)  # -> Index, Count
mindex_3 = MemberIndex(Set=smaller_3.SmallerThan, Member=bool_3)  # -> Index, Count
mindex_4 = MemberIndex(Set=smaller_4.SmallerThan, Member=bool_4)  # -> Index, Count
mindex_5 = MemberIndex(Set=smaller_5.SmallerThan, Member=bool_5)  # -> Index, Count
mindex_6 = MemberIndex(Set=smaller_6.SmallerThan, Member=bool_6)  # -> Index, Count
mindex_7 = MemberIndex(Set=smaller_7.SmallerThan, Member=bool_7)  # -> Index, Count
mindex_8 = MemberIndex(Set=smaller_8.SmallerThan, Member=bool_8)  # -> Index, Count
item_17 = ListItem(List=mindex.Count, Index=1, Wrap=False)
item_18 = ListItem(List=mindex_2.Count, Index=1, Wrap=False)
item_19 = ListItem(List=mindex_3.Count, Index=1, Wrap=False)
item_20 = ListItem(List=mindex_4.Count, Index=1, Wrap=False)
item_21 = ListItem(List=mindex_5.Count, Index=1, Wrap=False)
item_22 = ListItem(List=mindex_6.Count, Index=1, Wrap=False)
item_23 = ListItem(List=mindex_7.Count, Index=1, Wrap=False)
item_24 = ListItem(List=mindex_8.Count, Index=1, Wrap=False)
replace = ReplaceMembers(Set=item_17, Find=35, Replace=34)
replace_2 = ReplaceMembers(Set=item_18, Find=35, Replace=34)
replace_3 = ReplaceMembers(Set=item_19, Find=35, Replace=34)
replace_4 = ReplaceMembers(Set=item_20, Find=35, Replace=34)
replace_5 = ReplaceMembers(Set=item_21, Find=35, Replace=34)
replace_6 = ReplaceMembers(Set=item_22, Find=35, Replace=34)
replace_7 = ReplaceMembers(Set=item_23, Find=35, Replace=34)
replace_8 = ReplaceMembers(Set=item_24, Find=35, Replace=34)
item_25 = ListItem(List=ssln.L, Index=replace, Wrap=False)  # -> flatten(Item)
item_26 = ListItem(List=ssln_3.L, Index=replace_2, Wrap=False)  # -> flatten(Item)
item_27 = ListItem(List=ssln_5.L, Index=replace_3, Wrap=False)  # -> flatten(Item)
item_28 = ListItem(List=ssln_7.L, Index=replace_4, Wrap=False)  # -> flatten(Item)
item_29 = ListItem(List=ssln_9.L, Index=replace_5, Wrap=False)  # -> flatten(Item)
item_30 = ListItem(List=ssln_11.L, Index=replace_6, Wrap=False)  # -> flatten(Item)
item_31 = ListItem(List=ssln_13.L, Index=replace_7, Wrap=False)  # -> flatten(Item)
item_32 = ListItem(List=ssln_15.L, Index=replace_8, Wrap=False)  # -> flatten(Item)
pull = PullPoint(Point=item_25, Geometry=crv, ClosestOnly=True)  # -> ClosestPoint, Distance
pull_2 = PullPoint(Point=item_26, Geometry=crv, ClosestOnly=True)  # -> ClosestPoint, Distance
pull_3 = PullPoint(Point=item_27, Geometry=crv, ClosestOnly=True)  # -> ClosestPoint, Distance
pull_4 = PullPoint(Point=item_28, Geometry=crv, ClosestOnly=True)  # -> ClosestPoint, Distance
pull_5 = PullPoint(Point=item_29, Geometry=crv, ClosestOnly=True)  # -> ClosestPoint, Distance
pull_6 = PullPoint(Point=item_30, Geometry=crv, ClosestOnly=True)  # -> ClosestPoint, Distance
pull_7 = PullPoint(Point=item_31, Geometry=crv, ClosestOnly=True)  # -> ClosestPoint, Distance
pull_8 = PullPoint(Point=item_32, Geometry=crv, ClosestOnly=True)  # -> ClosestPoint, Distance
dist = Distance(PointA=item_25, PointB=pull.ClosestPoint)
dist_2 = Distance(PointA=item_26, PointB=pull_2.ClosestPoint)
dist_3 = Distance(PointA=item_27, PointB=pull_3.ClosestPoint)
dist_4 = Distance(PointA=item_28, PointB=pull_4.ClosestPoint)
dist_5 = Distance(PointA=item_29, PointB=pull_5.ClosestPoint)
dist_6 = Distance(PointA=item_30, PointB=pull_6.ClosestPoint)
dist_7 = Distance(PointA=item_31, PointB=pull_7.ClosestPoint)
dist_8 = Distance(PointA=item_32, PointB=pull_8.ClosestPoint)
avr = Average(Input=dist)
avr_2 = Average(Input=dist_2)
avr_3 = Average(Input=dist_3)
avr_4 = Average(Input=dist_4)
avr_5 = Average(Input=dist_5)
avr_6 = Average(Input=dist_6)
avr_7 = Average(Input=dist_7)
avr_8 = Average(Input=dist_8)
round = Round(Number=[avr, avr_2, avr_3, avr_4, avr_5, avr_6, avr_7, avr_8])  # -> Nearest, Floor, Ceiling
concat = Concatenate(
    FragmentA=["South - ", "Southeast - ", "East - ", "Northeast - ", "North - ", "Northwest - ", "West - ", "Southwest - "],
    FragmentB=round.Nearest,
    FragmentC="ft")
R = ClusterOutput(concat)
N = ClusterOutput(round.Nearest)

# ==== cluster SubsetListsWithLengthN: Create subset lists with length N. C culls remainder.
cull_remainder = ClusterInput()
subset_length = ClusterInput()
list = ClusterInput()
cull_remainder_2 = Boolean(cull_remainder)
subset_length_2 = Integer(subset_length)
list_2 = Data(list)
lng = ListLength(List=list_2)
division = Division(A=lng, B=subset_length_2)
integer_division = IntegerDivision(A=lng, B=subset_length_2)
num = Number(expr("Ceiling(x)", division))
filter = StreamFilter(Gate=cull_remainder_2, Stream0=num, Stream1=integer_division)
series = Series(Start=0, Step=subset_length_2, Count=filter)  # -> simplify(Series)
addition = Addition(A=series, B=subset_length_2)
dom = Domain(DomainStart=series, DomainEnd=expr("x-1", addition))
subset = SubList(List=list_2, Interval=dom, Cycle=False)  # -> List, Index
L = ClusterOutput(subset.List)
I = ClusterOutput(subset.Index)
